# Grasshopper definition Ray Tracing.gh (Grasshopper 0.9.76)
# plug-ins: G E N E R A T I O N, Python Interpreter

panel = Panel("Initial Ray tracing")
geo = Geometry(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)
clock = Clock(SecondHand=True)
geo_2 = Geometry(geo)
calendar = Calendar()
sou = ConstructPoint(XCoordinate=Slider(5, range=0..30), YCoordinate=Slider(5, range=0..30), ZCoordinate=Slider(5, range=0..30))
debrep = DeconstructBrep(Brep=geo_2)  # -> Faces, Edges, Vertices
python = PythonScript(x=geo_2, y=sou)  # -> out, a; inputs x: Brep, y: Point3d
# ---------- python: Python ----------
a = x.IsPointInside(y,0.01,True)
# ---------- end python ----------

# ---- group: Source point
pt = Point(sou)

# ----
Z = UnitZ(Factor=Slider(5, range=0..10))
evalsrf = EvaluateSurface(Surface=reparameterize(debrep.Faces), Point=Point(0.5, 0.5, 0))  # -> Point, Normal, Frame
item = ListItem(List=debrep.Faces, Index=1, Wrap=True)

# ---- group: Is source point within Geometry
panel_2 = Panel(python.a)

# ----
move = Move(Geometry=pt, Motion=Z)  # -> Geometry, Transform

# ---- group: Number of Rays
number_slider = Slider(2, range=1..100)

# ----
rev = Reverse(Vector=evalsrf.Normal)
vec2pt = Vector2Pt(PointA=pt, PointB=move.Geometry, Unitize=False)  # -> Vector, Length
vdis = VectorDisplay(Anchor=evalsrf.Point, Vector=rev)
panel_3 = Panel(rev)
vec = Vector(vec2pt.Vector)
X = UnitX(Factor=1)
random = Random(Range="0 To 2*Pi", Number=number_slider, Seed=1)
random_2 = Random(Range="0 To 2*Pi", Number=number_slider, Seed=2)
random_3 = Random(Range="0 To 2*Pi", Number=number_slider, Seed=3)
Y = UnitY(Factor=1)
vrot = Rotate(Vector=vec, Axis=X, Angle=random)
Z_2 = UnitZ(Factor=1)
vrot_2 = Rotate(Vector=vrot, Axis=Y, Angle=random_2)
vrot_3 = Rotate(Vector=vrot_2, Axis=Z_2, Angle=random_3)
project = ProjectPoint(Point=pt, Direction=vrot_3, Geometry=debrep.Faces)  # -> Point, Index
vdis_2 = VectorDisplay(Anchor=pt, Vector=vrot_3)
item_2 = ListItem(List=debrep.Faces, Index=project.Index, Wrap=True)
item_3 = ListItem(List=rev, Index=project.Index, Wrap=True)

# ---- group: Ray Vectors
vec2pt_2 = Vector2Pt(PointA=pt, PointB=project.Point, Unitize=False)  # -> Vector, Length
vdis_3 = VectorDisplay(Anchor=pt, Vector=vec2pt_2.Vector)

# ----
vec_2 = Vector(item_3)
timer = Timer(TimerInterval=1000, Target=count)
xz = XZPlane(Origin=Point(0, 0, 0))
count = Counter(Start=0, Step=1, Pause=Toggle(True), Reset=Toggle(True))
angle = Angle(VectorA=vec2pt_2.Vector, VectorB=vec_2, Plane=xz)  # -> Angle, Reflex
mirror = Mirror(Geometry=vec2pt_2.Vector, Plane=xz)  # -> Geometry, Transform
panel_4 = Panel(count)
xz_2 = XZPlane(Origin=Point(0, 0, 0))
yz = YZPlane(Origin=Point(0, 0, 0))
mirror_2 = Mirror(Geometry=mirror.Geometry, Plane=xz_2)  # -> Geometry, Transform
panel_5 = Panel(angle.Angle)
mirror_3 = Mirror(Geometry=mirror_2.Geometry, Plane=yz)  # -> Geometry, Transform
vdis_4 = VectorDisplay(Anchor=project.Point, Vector=mirror_3.Geometry)
vdis_5 = VectorDisplay(Anchor=project.Point, Vector=mirror_2.Geometry)
