# Grasshopper definition RayTracing_01.gh (Grasshopper 0.9.76)
# plug-ins: Python Interpreter

brep = Brep(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)
pt = ConstructPoint(
    XCoordinate=Slider(1723, range=0..10000),
    YCoordinate=Slider(1723, range=0..10000),
    ZCoordinate=Slider(1500, range=0..10000))
pt_2 = ConstructPoint(
    XCoordinate=Slider(7612, range=0..10000),
    YCoordinate=Slider(3802, range=0..10000),
    ZCoordinate=Slider(1500, range=0..10000))
geo = Geometry(brep)
python = PythonScript(G=geo, n=Slider(1000, range=1..1000), SP=pt, RP=pt_2, alpha=Slider(0.5, range=0..1), Run=Toggle(False))  # -> Messages, ReverberationTime; inputs G: Brep, n: Int32, SP: Point3d, RP: Point3d
# ---------- python: Python ----------
import random
import math
import rhinoscriptsyntax as rs
import Rhino as rc
import clr

Geo=rc.Geometry.Brep.Duplicate(G)
Origo=rs.AddPoint(0,0,0)
V = rs.SurfaceVolume(Geo)
    

#Testing wether source point is contained within Geometry
SPC = Geo.IsPointInside(SP,0.01,True)


#Testing wether receiver point is contained within Geometry
RPC = Geo.IsPointInside(RP,0.01,True)


#Number of Surfaces in Geometry
F = Geo.Surfaces.Count


#Extracting Surfaces from Geometry
Surfaces = []
def Surf(f):
    surface = rs.ExtractSurface(G,f,copy=True)
    return surface[0]
for f in range (F):
    Surfaces.append(Surf(f))


#Extracting Surface Points from Geometry Surfaces
SurfPoints = []
def SurfacePoints(f):
    point = rs.SurfaceAreaCentroid(Surfaces[f])
    return point[0]
for f in range (F):
    SurfPoints.append(SurfacePoints(f))


#Surface Normal Vectors
Param = []
def UV_Param(f):
    point = rs.SurfaceClosestPoint(Surfaces[f],SurfPoints[f])
    return point[0]
for f in range (F):
    Param.append(UV_Param(f))
    
SurfNormal = []
def SurfaceNormal(f):
    vector = rs.VectorReverse(rs.SurfaceNormal(Surfaces[f],Param))
    return vector
for f in range (F):
    SurfNormal.append(SurfaceNormal(f))
    
    
#Ray Vector Points
def RayPoints(theta,phi):
    point = rs.AddPoint(math.sin(theta)*math.cos(phi),math.sin(theta)*math.sin(phi),math.cos(theta))
    return point
#Ray Vectors between Ray Vector Points and Origo
def RayVectors(RayPoints,OrigoPoints):
    Vector = rs.VectorCreate(RayPoints,Origo)
    return Vector
    
#k=math.log10(V[0])
#r=(k*rs.Distance(SP,RP)*math.sqrt(4/n))/(10**3)
r = 250

Messages=[]
Alpha = []
for i in range (F):
    Alpha.append(alpha)
    
if Run == True:
    if SPC == True:
        if RPC == True:
            
            Energy = []
            DT = []
            for i in range (n):
                
                #RayVectors
                RayVec = []
                for i in range (n):
                    theta = random.uniform(0,(2*math.pi))  
                    phi = random.uniform(0,(2*math.pi))
                    RayVec.append(RayVectors(RayPoints(theta,phi),Origo))
                    
                ReflectionPoints = [SP]
                RefVec = [RayVec[0]]
                Distances = []
                MinDistances = []
                Rays = []
                RayData = []
                RayData.append(SP)
                RayData.append(RayVec[0])
                TravelLength = 0
                E = 1
                while E > 1*10**-6:
                    #Vector From Source to Geometry Surfaces
                    LenVec = []
                    def LengthVectors(f):
                        vector = rs.VectorCreate(SurfPoints[f],RayData[0])
                        return vector
                    for f in range (F):
                        LenVec.append(LengthVectors(f))
                    
                    Dist = []
                    #Distance from Source Point to Geometry Surfaces
                    def Distance(f):
                        length = (rs.VectorDotProduct(SurfNormal[f],LenVec[f]))/(rs.VectorDotProduct(RayData[1],SurfNormal[f]))
                        return length
                    for f in range (F):
                        Dist.append(Distance(f))
                    
                        Distances.append(Distance(f))
                
                    #Minimum distance
                    DistMin = min(n for n in Dist if n > 1*10**-9)
                    index = [i for i,x in enumerate(Dist) if x == DistMin]
                    
                    #Reflection Point
                    ReflectionPoint = RayData[0]+RayData[1]*DistMin
                    
                    ReflectionPoints.append(ReflectionPoint)
                    ReflectPoints=ReflectionPoints[:-1]
                    
                    Rays.append(rs.VectorCreate(ReflectionPoint,RayData[0]))
                    
                    w=rs.VectorCreate(ReflectionPoint,RP)
                    A = rs.VectorDotProduct(RayData[1],w)
                    B = rs.VectorLength(w)**2
                    
                    if rs.VectorDotProduct(RayData[1],w) > 0 and (A**2-B+r**2) >= 0 and DistMin >= -A:
                        Line=rs.AddLine(RayData[0],ReflectionPoint)
                        LineSphereInt=rs.LineSphereIntersection(Line,RP,r)
                        E = math.exp(-0.0009*10**-3*rs.Distance(RayData[0],LineSphereInt[0]))*E
                        TravelLength = TravelLength+rs.Distance(RayData[0],LineSphereInt[0])
                        Energy.append(E)
                        DecayTime = (TravelLength/(10**3))/343
                        DT.append(DecayTime)
                        
                        break
                    else:
                        
                        #Reflected Vector
                        ReflectionVec = rs.VectorSubtract(RayData[1],(2*SurfNormal[index[0]]*rs.VectorDotProduct(SurfNormal[index[0]],RayData[1])))
                        
                        RefVec.append(ReflectionVec)
                        
                        RayData=(ReflectionPoint,ReflectionVec)
                        
                        E = math.exp(-0.0009*10**-3*DistMin)*(1-Alpha[index[0]])*E
                        
                        TravelLength = TravelLength+DistMin
                        
                        DecayTime = (TravelLength/(10**3))/343
                        
                        if E < 1*10**-6:
                            DT.append(DecayTime)
                            Energy.append(E)
                        
                        
        else:
            M1 = ("Receiver Point is outside Geometry")
            Messages.append(M1)
        
    else:
        M2 = ("Source Point is outside Geometry")
        Messages.append(M2)
RT = []
SPL = []
for i in range (n):
    SPL.append(10*math.log10(Energy[i]))
for i in range (n):
    RT.append(DT[i])

RT1 = RT
SPL1 = SPL
RTSPL = zip(RT1,SPL1)

RTSPL.sort()
SPL_Sorted = [SPL1 for RT1, SPL1 in RTSPL]

RT1 = [list(RT1) for RT1 in zip(*RTSPL)]

SPL = SPL_Sorted
RT = RT1[0]

RT_1000 = []

TimeSteps = range(int(math.floor(min(RT))),int(math.ceil(max(RT)*1000))+3,3)

Indexes = []

def RT1000(t):
    Item = RT[t]*1000
    return Item
    
for t in range (len(RT)):
    RT_1000.append(RT1000(t))
    i = 0
    while i < len(TimeSteps):
        if  TimeSteps[i] <= RT_1000[t] <= TimeSteps[1+i]:
            Indx = ([q for q,x in enumerate(RT_1000) if x == RT_1000[t]])
            Indexes.append([Indx[0],(TimeSteps[i]+TimeSteps[1+i])/2])
            break
        else:
            i = i+1
    
CollectiveSplIndexes = []
CollectiveDecaytimes = []

q = 0
while q < len(TimeSteps):
    SplIndexes = []
    Decaytimes = []
    p = 0
    while p < len(Indexes):
        if TimeSteps[q] <= Indexes[p][1] <= TimeSteps[1+q]:
            SplIndexes.append(Indexes[p][0])
            Decaytimes.append(Indexes[p][1])
            break
        else:
            p = p+1
            
    CollectiveSplIndexes.append(SplIndexes)
    CollectiveDecaytimes.append(Decaytimes)
    q = q+1

SPLSums = []
for i in range (len(CollectiveSplIndexes)):
    if CollectiveSplIndexes[i] == []:
        continue
    else:
        a = 0
        w = 0
        while w < (len(CollectiveSplIndexes[i])):
            a = a + (SPL[CollectiveSplIndexes[i][w]])
            w = w + 1
    SPLSums.append(a)

DecayTimes = []
for i in range (len(CollectiveDecaytimes)):
    if CollectiveDecaytimes[i] == []:
        continue
    else:
        b = CollectiveDecaytimes[i][0]*10**(-3)
        
        DecayTimes.append(b)

DecayValues = [0] + SPLSums
DecayTimes = [0] + DecayTimes

#SPL values just below and above -5 dB
SPLlowmin = min(n for n in DecayValues if n > -5)
lowminindex = [i for i,x in enumerate(DecayValues) if x == SPLlowmin]

SPLlowmax = max(n for n in DecayValues if n < -5)
lowmaxindex = [i for i,x in enumerate(DecayValues) if x == SPLlowmax]

#Interpolation for the -5 dB point
FivedBDecay = (((-5-SPLlowmin)*(DecayTimes[lowmaxindex[0]]-DecayTimes[lowminindex[0]]))/(SPLlowmax-SPLlowmin))+DecayTimes[lowminindex[0]]
#print FivedBDecay
#print SPLlowmin+(FivedBDecay-DecayTimes[lowminindex[0]])*((SPLlowmax-SPLlowmin)/(DecayTimes[lowmaxindex[0]]-DecayTimes[lowminindex[0]]))

#SPL values just below and above -35 dB
SPLhighmin = min(n for n in DecayValues if n > -35)
highminindex = [i for i,x in enumerate(DecayValues) if x == SPLhighmin]

SPLhighmax = max(n for n in DecayValues if n < -35)
highmaxindex = [i for i,x in enumerate(DecayValues) if x == SPLhighmax]

#Interpolation for the -35 dB point
ThirtyfivedBDecay = (((-35-SPLhighmin)*(DecayTimes[highmaxindex[0]]-DecayTimes[highminindex[0]]))/(SPLhighmax-SPLhighmin))+DecayTimes[highminindex[0]]
#print ThirtyfivedBDecay
#print SPLhighmin+(ThirtyfivedBDecay-DecayTimes[highminindex[0]])*((SPLhighmax-SPLhighmin)/(DecayTimes[highmaxindex[0]]-DecayTimes[highminindex[0]]))

ReverberationTime = (ThirtyfivedBDecay - FivedBDecay)*2
print ReverberationTime
# ---------- end python ----------
panel = Panel(python.Messages)
panel_2 = Panel(python.ReverberationTime)
